# Grasshopper definition wasp.gh (Grasshopper 1.0.7)

# ----
# 0_01_Basic_Aggregation
# 1. Build Part
# Parts are the building blocks of Wasp.
# The most basic way of initializing a part is to define t he geometry (as brep or mesh),
# and the connection faces (center and orientation - with a line). Parts must be named
# to be identifyed in the aggregation rules.
part_geometry = Brep(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)
connections_centers = Point([Point(0, 8.660254038, 5), Point(-7.5, -4.330127019, 5), Point(7.5, -4.330127019, 5)])
connections_x_axis = Curve([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])
conndir = Wasp_ConnectionFromDirection(GEO=part_geometry, CEN=connections_centers, UP=connections_x_axis)  # -> CONN, PLN_OUT; inputs CEN: list of Point3d, UP: list of Curve, T: list; plug-in component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
# # Wasp: Discrete Design with Grasshopper plug-in (GPL) initiated by Andrea Rossi
# 
# 
# This file is part of Wasp.
# 
# Copyright (c) 2021, Andrea Rossi <a.rossi.andrea@gmail.com>
# 
# Wasp is free software; you can redistribute it and/or modify it under the terms of the GNU General Public License as published by the Free Software Foundation; either version 3 of the License, or (at your option) any later version.
# 
# Wasp is distributed in the hope that it will be useful, but WITHOUT ANY WARRANTY; without even the implied warranty of MERCHANTABILITY or FITNESS FOR A PARTICULAR PURPOSE. See the GNU General Public License for more details. You should have received a copy of the GNU General Public License
#  along with Wasp; If not, see <http://www.gnu.org/licenses/>.
# 
# license GPL-3.0 <https://www.gnu.org/licenses/gpl.html>
# 
# Significant parts of Wasp have been developed by Andrea Rossi as part of research on digital materials and discrete design at DDU Digital Design Unit - Prof. Oliver Tessmann - Technische Universität Darmstadt
part_name = Panel("HEXA")
points = PointList(Points=connections_centers, Size=Slider(2, range=0..10))
part = Wasp_BasicPart(NAME=part_name, GEO=part_geometry, CONN=flatten(conndir.CONN))  # -> PART; inputs GEO: Mesh, CONN: list, ATTR: list; plug-in component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

# ----
# 2. Define aggregation rules
# Rules define which connection of which part can be
# connected with each other to for the aggregation.
# 
# NB: Rules are directional! So if you want to connect 1 to 2 and 2 to 1,
# you need to write two separate rules.
number_slider = Slider(0, range=0..10)
part_name_2 = Panel("HEXA")
rule = Wasp_Rule(P1=part_name_2, C1=number_slider, P2=part_name_2, C2=Slider(0, range=0..10))  # -> R; inputs C1: Int32, C2: Int32; plug-in component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
rule_2 = Wasp_Rule(P1=part_name_2, C1=Slider(0, range=0..10), P2=part_name_2, C2=Slider(1, range=0..10))  # -> R; inputs C1: Int32, C2: Int32; plug-in component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
rule_3 = Wasp_Rule(P1=part_name_2, C1=Slider(2, range=0..10), P2=part_name_2, C2=Slider(1, range=0..10))  # -> R; inputs C1: Int32, C2: Int32; plug-in component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
merge = Merge(Data1=rule, Data2=rule_2, Data3=rule_3)

rnd_seed = GetInteger(Slider(25, range=0..1000), AtLeast=1, AtMost=1, Maximum=2147483647, Minimum=-2147483648, TreeAccess=False)

# ----
# 3. Aggregate!
# Stochastic Aggregation builds an aggregation by randomly selecting one part
# and one rule to be applied at every step.
# The component adds parts additively over the already aggregated parts.
# If a new aggregation has to be created, the RESET button allows to reset
# the aggregation and restart.
parts_num = Slider(100, range=0..1000)
parts_num_2 = GetInteger(parts_num, AtLeast=1, AtMost=1, Maximum=2147483647, Minimum=-2147483648, TreeAccess=False)
reset = Button()
stochasticaggregation = Wasp_StochasticAggregation(PART=flatten(part), N=parts_num_2, RULES=merge, SEED=rnd_seed, RESET=reset)  # -> AGGR, PART_OUT; inputs PART: list, PREV: list, N: Int32, RULES: list, SEED: Int32, MODE: Int32, GC: list, RESET: Boolean; plug-in component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

# ----
# 4. Visualize
# In order to visualize the result, it is necessary to extract
# the part geometry from the part itself.
partgeo = Wasp_GetPartGeometry(PART=stochasticaggregation.PART_OUT)  # -> GEO; plug-in component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
preview = CustomPreview(Geometry=partgeo, Material=ColourSwatch(SwatchColor=RGB(119, 255, 0)))

python = GhPythonScript(x=stochasticaggregation.PART_OUT)  # -> a
# ---------- python: Python ----------
a = x.center
# ---------- end python ----------
python_2 = GhPythonScript(x=stochasticaggregation.PART_OUT)  # -> a
# ---------- python_2: Python ----------
a = x.id
# ---------- end python_2 ----------
context_bake = ContextBake(Geometry=partgeo)
context_print = ContextPrint(Part_ids=python_2)
